# Grasshopper definition Natalia_Campos_ObjectsFinal2.0.gh (Grasshopper 1.0.7)

series = Series(Start="1", Step=1, Count="600")
ghpython_script = GhPythonScript(stop=series, rVal1="7", rVal2="15", rVal3="6", s="12", radius="200")  # -> points, Cpoints; inputs stop: Int32, rVal1: Int32, rVal2: Int32, rVal3: Int32, s: Int32
# ---------- ghpython_script: Python ----------
__author__ = "camposn"
__version__ = "2021.04.07"

import rhinoscriptsyntax as rs

from math import radians
from math import cos
from math import sin

def TrigCirc(HorAngle, VerAngle, Radius, CenterX, CenterY, CenterZ, Rotation, Orient):
    
    X1 = []
    Y1 = []
    Z1 = []
    
    for i in range(int(Rotation)):
        
        Hor = radians(HorAngle*i)
        Ver = radians(VerAngle*i)
        
        if Orient == "ThreeD":
        
            #construct coordinates on the circle
            x = cos(Hor)*Radius*sin(Ver) + CenterX
            y = sin(Hor)*Radius*sin(Ver) + CenterY
            z = cos(Ver)*Radius + CenterZ
            
        if Orient == "Top":
            #construct coordinates on the circle
            x = cos(Hor)*Radius*sin(Ver) + CenterX
            y = sin(Hor)*Radius*sin(Ver) + CenterY
            z = 0 + CenterZ
            
        if Orient == "Front":
            #construct coordinates on the circle
            x = cos(Hor)*Radius*sin(Ver) + CenterX
            y = cos(Ver)*Radius + CenterZ
            z = 0 + CenterY            
        
        if Orient == "Oblique":
            #construct coordinates on the circle
            x = cos(Hor)*Radius*sin(Ver) + CenterX
            y = sin(Hor)*Radius*sin(Ver) - cos(Ver)*Radius/2+CenterZ*.4+CenterY*.2
            z = 0 + CenterZ
              
        #append coordinates to list
        X1.append(x)
        Y1.append(y)
        Z1.append(z)
        print(Radius)
    return(x,y,z, HorAngle, VerAngle)

horAng = 360/s

verAng = .05

rotation1 = rVal1*stop
rotation2 = rVal2*stop
rotation3 = rVal3*stop

#creates different views of the sphere
pt1 = TrigCirc(-horAng,verAng,radius,0,0,0,rotation1,"ThreeD")
pt2 = TrigCirc(horAng/2,verAng,radius/4,pt1[0],pt1[1],pt1[2],rotation2*2,"ThreeD")
pt3 = TrigCirc(horAng,verAng,radius/8,pt2[0],pt2[1],pt2[2],rotation3,"ThreeD")

Cpoints = rs.AddPoint(0,0,pt3[2])
points = rs.AddPoint(pt3[0],pt3[1],pt3[2])
# ---------- end ghpython_script ----------
unit_z = UnitZ(Factor=".02")
multiplication = Multiplication(A="12", B="1")

# ---- group: Faces
partition_list = PartitionList(List=ghpython_script.points, Size=multiplication)
flip_matrix = FlipMatrix(Data=partition_list)
polyline = PolyLine(Vertices=partition_list, Closed=False)
loft_options = LoftOptions(Closed=False, Adjust=False, Rebuild=0, Refit=0, Type="1")
polyline_2 = PolyLine(Vertices=flip_matrix, Closed=False)
loft = Loft(Curves=flatten(polyline_2), Options=loft_options)
deconstruct_brep = DeconstructBrep(Brep=loft)  # -> Faces, Edges, Vertices

# ---- group: Object Extrustion
polyline_3 = PolyLine(Vertices=ghpython_script.points, Closed=False)
vector_2pt = Vector2Pt(PointA=ghpython_script.Cpoints, PointB=ghpython_script.points, Unitize=Toggle(True))  # -> Vector, Length
extrude = Extrude(Base=polyline_3, Direction=unit_z)
amplitude = Amplitude(Vector=vector_2pt.Vector, Amplitude=".02")
deconstruct_brep_2 = DeconstructBrep(Brep=extrude)  # -> Faces, Edges, Vertices
extrude_2 = Extrude(Base=deconstruct_brep_2.Faces, Direction=amplitude)

# ---- group: Geometry
ghpython_script_2 = GhPythonScript(Geometry="Vertical")  # -> Gate
# ---------- ghpython_script_2: Python ----------
__author__ = "camposn"
__version__ = "2021.04.14"

import rhinoscriptsyntax as rs

if Geometry == None:
    Gate = None
else:
    if Geometry == "Solids":
        Gate = 0
    if Geometry == "Vertical":
        Gate = 1
    if Geometry == "Horizontal":
        Gate = 2
# ---------- end ghpython_script_2 ----------
panel = Panel(ghpython_script_2)

# ----
ghpython_script_3 = GhPythonScript(List=flatten(polyline))  # -> Index; inputs List: list
# ---------- ghpython_script_3: Python ----------
__author__ = "camposn"
__version__ = "2021.04.14"

import rhinoscriptsyntax as rs
Index = len(List)-1
# ---------- end ghpython_script_3 ----------
subtraction = Subtraction(A=ghpython_script_3, B="1")
list_item = ListItem(List=flatten(polyline), Index=subtraction, Wrap=subtraction)

# ---- group: Platform Extrusion
geo = Geometry(ghpython_script.Cpoints)  # disabled
ghpython_script_4 = GhPythonScript(List=flatten(geo))  # -> Index; inputs List: list; same code as ghpython_script_3
subtraction_2 = Subtraction(A=ghpython_script_4, B="1")
list_item_2 = ListItem(List=flatten(geo), Index=subtraction_2, Wrap=subtraction_2)
xy = XYPlane(Origin=list_item_2)
project = Project(Geometry=list_item, Plane=xy)  # -> Geometry, Transform
boundary = BoundarySurfaces(Edges=project.Geometry)
Z = UnitZ(Factor=1)
extr = Extrude(Base=boundary, Direction=Z)  # disabled

# ----
stream_filter = StreamFilter(Gate=panel, Stream0=extrude_2, Stream1=deconstruct_brep.Faces)

# ---- group: RGB Creation for Object
list_length = ListLength(List=stream_filter)
division = Division(A="1", B=list_length)
series_2 = Series(Start=0, Step=division, Count=list_length)
ghpython_script_5 = GhPythonScript(R="50", G="255", B="100", R2="255", G2="50", B2="50", Percent=series_2)  # -> Color
# ---------- ghpython_script_5: Python ----------
__author__ = "camposn"
__version__ = "2021.04.13"

import rhinoscriptsyntax as rs

def LinearColor(R,G,B,R2,G2,B2,ColorPercentage):
    
    #This function defines linear color gradient by treating R,G,B as coordinates on a 3D line.
    #The base color that will be altered by the percentage should be entered in the second R2,G2,B2 valu
    
    Rdiff = R2 - R
    Gdiff = G2 - G
    Bdiff = B2 - B


    t = ColorPercentage


    R3 = float(R + Rdiff*t)
    G3 = float(G + Gdiff*t)
    B3 = float(B + Bdiff*t)

    Color = rs.CreateColor(R3,G3,B3)

    return (Color)
    
if (R or G or B or Percent) is None:
    Color = None
else:
    Color = LinearColor(R2,G2,B2,R,G,B,Percent)
# ---------- end ghpython_script_5 ----------

# ---- group: Platform RGB
list_length_2 = ListLength(List=ghpython_script_5)
division_2 = Division(A="1", B=list_length_2)
series_3 = Series(Start=0, Step=division_2, Count=list_length_2)
list_item_3 = ListItem(List=ghpython_script_5, Index=series_3, Wrap=True)
custom_preview = CustomPreview(Material=list_item_3)  # disabled

# ----
custom_preview_2 = CustomPreview(Geometry=stream_filter, Material=ghpython_script_5)
